# Grasshopper definition UI.gh (Grasshopper 1.0.7)
# plug-ins: Human UI, GH_CPython

button = CreateButton(ButtonName="Select free stages", ButtonStyle=0)

filepicker = CreateFilePicker(ButtonLabelText="Browse folder...", DialogType=2, MustExist=True, Filter="All Files|*.*")
tb = CreateTextBlock(Text="\"Waiting on folder path...\"", TextSize=12, Justification=0)
label = CreateLabel(LabelText="Locate the \"recompfig\" folder to get started.", LabelSize=12, Justification=0)
label_2 = CreateLabel(LabelText="Message", LabelSize=12, Justification=0)
merge = Merge(Data1=label, Data2=filepicker, Data3=label_2, Data4=tb)
values = ValueListener(Elements=filepicker, SomeProperty=True)  # -> Values, Indices
path = FilePath(values.Values)
python = GhPythonScript(path=path)  # -> out, msg, msgStep1, folderPath, CMCorePath, visualizerPath, iconPath, handlerFlag
# ---------- python: Python ----------
__author__ = "MML"
__version__ = "2021.12.31"

import rhinoscriptsyntax as rs

folderPath = []



if(len(path) == 0):
    msg = "Waiting on folder path..."
    handlerFlag = True
elif(not path.endswith("recompfig")):
    msg = "This is not the right folder. Please try again."
    handlerFlag = True
else:
    msg = "Done! please move forward to step 1."
    msgStep1 = "Nothing to report."
    path = path.replace('\\', '/')
    folderPath = path
    CMCorePath = path + "/CMCore.py"
    visualizerPath = path + "/visualizer.py"
    iconPath = path + "/icons/"
    handlerFlag = False
# ---------- end python ----------
settextblock = SetTextBlockContents(TextBlockToModify=tb, NewTextBlockContents=python.msg)

button_2 = CreateButton(ButtonName="Bake elements to Rhino viewport", ButtonStyle=0)

panel = Panel("""Rotational freedom space
Translational freedom space
Constraint space
Over-constraints
Flexural rods
Cables
Cable twins
Sensors
Sensor twins""")
merge_2 = Merge(
    Data1=ColourSwatch(SwatchColor=RGB(255, 0, 0)),
    Data2=ColourSwatch(SwatchColor=RGB(0, 255, 0)),
    Data3=ColourSwatch(SwatchColor=RGB(0, 0, 255)),
    Data4=ColourSwatch(SwatchColor=RGB(255, 0, 255)),
    Data5=ColourSwatch(SwatchColor=RGB(0, 0, 0)),
    Data6=ColourSwatch(SwatchColor=RGB(236, 100, 43)),
    Data7=ColourSwatch(SwatchColor=RGB(255, 255, 0)),
    Data8=ColourSwatch(SwatchColor=RGB(0, 255, 255)),
    Data9=ColourSwatch(SwatchColor=RGB(68, 0, 255)))
colorpicker = CreateColorPicker(DefaultColor=merge_2)  # -> graft(ColorPicker)
label_3 = CreateLabel(LabelText=panel, LabelSize=12, Justification=0)  # -> graft(Label)
merge_3 = Merge(Data1=colorpicker, Data2=label_3)  # -> flatten(Result)

file = ReadFile(File=python.CMCorePath, PerLineParse=False)
compmechcore = GhPythonScript(Code=file)  # -> Out, CM
textbox = CreateTextBox(Label="Constraint subspace count", DefaultText="0", UpdateButton=False, showLabel=True)
textbox_2 = CreateTextBox(Label="Mode count", DefaultText="1", UpdateButton=False, showLabel=True)
textbox_3 = CreateTextBox(Label="Cable group count", DefaultText="0", UpdateButton=False, showLabel=True)
textbox_4 = CreateTextBox(Label="Sensor group count", DefaultText="0", UpdateButton=False, showLabel=True)
textbox_5 = CreateTextBox(Label="Cable constraint space count", DefaultText="0", UpdateButton=False, showLabel=True)
textbox_6 = CreateTextBox(Label="Sensor constraint space count", DefaultText="0", UpdateButton=False, showLabel=True)
textbox_7 = CreateTextBox(Label="Mode freedom space count", DefaultText="0", UpdateButton=False, showLabel=True)
toggle = BooleanToggle(False)
merge_4 = Merge(Data1=textbox_2, Data2=textbox, Data3=textbox_3, Data4=textbox_4, Data5=textbox_7, Data6=textbox_5, Data7=textbox_6)
expander = CreateExpander(UIElements=merge, Header="Step 0: Setup", Open=True)
expander_2 = CreateExpander(UIElements=merge_3, Header="Viewer settings", Open=False)
expander_3 = CreateExpander(UIElements=merge_4, Header="System var", Open=True)
values_2 = ValueListener(Elements=textbox_2, SomeProperty=True)  # -> Values, Indices
values_3 = ValueListener(Elements=textbox_5, SomeProperty=True)  # -> Values, Indices
values_4 = ValueListener(Elements=textbox_6, SomeProperty=True)  # -> Values, Indices
values_5 = ValueListener(Elements=textbox, SomeProperty=True)  # -> Values, Indices
values_6 = ValueListener(Elements=textbox_7, SomeProperty=True)  # -> Values, Indices
values_7 = ValueListener(Elements=textbox_3, SomeProperty=True)  # -> Values, Indices
values_8 = ValueListener(Elements=textbox_4, SomeProperty=True)  # -> Values, Indices
hideshow = HideShowElement(ElementToHideShow=expander_3, Show=toggle, Collapse=True, Disable=False)
hideshow_2 = HideShowElement(ElementToHideShow=expander_2, Show=toggle, Collapse=True, Disable=False)
modefreespacecount = Text(values_6.Values)
sensorconspacecount = Text(values_4.Values)
modecount = Integer(values_2.Values)
subspacecount = Integer(values_5.Values)

of_constraint_sub_spaces = Integer(subspacecount)
button_3 = CreateButton(ButtonName="Reset", ButtonStyle=0)
button_4 = CreateButton(ButtonName="Add flexural rod", ButtonStyle=0)
button_5 = CreateButton(ButtonName="Delete rod", ButtonStyle=0)
button_6 = CreateButton(ButtonName="Bake directional guides", ButtonStyle=0)
button_7 = CreateButton(ButtonName="Bake positional guides", ButtonStyle=0)
series = Series(Start=1, Step=1, Count=of_constraint_sub_spaces)
merge_5 = Merge(Data1=button_3, Data2=button_4, Data3=button_5)
format = Format(Format="View constraint subspace {0}", Culture=127, Data0=series)
merge_6 = Merge(Data2=button_6, Data3=button_7)
wrappanel = CreateWrapPanel(UIElements=merge_6, Horizontal=True)
checklist = CreateChecklist(ChecklistItems=format, Selected=False)
wrappanel_2 = CreateWrapPanel(UIElements=merge_5, Horizontal=True)
tb_2 = CreateTextBlock(Text="Waiting on step 1...", TextSize=12, Justification=0)
label_4 = CreateLabel(LabelText="Message", LabelSize=12, Justification=0)
merge_7 = Merge(
    Data1=flatten(wrappanel_2),
    Data2=flatten(checklist),
    Data3=flatten(label_4),
    Data4=flatten(wrappanel),
    Data5=flatten(tb_2))

values_9 = ValueListener(Elements=button_3, SomeProperty=True)  # -> Values, Indices
values_10 = ValueListener(Elements=button_4, SomeProperty=True)  # -> Values, Indices
values_11 = ValueListener(Elements=button_5, SomeProperty=True)  # -> Values, Indices
resetrod = Boolean(values_9.Values)
addrod = Boolean(values_10.Values)
deleterod = Boolean(values_11.Values)

expander_4 = CreateExpander(UIElements=merge_7, Header="Step 2: Flexural rods", Open=False)
cablecount = Integer(values_7.Values)
sensorcount = Integer(values_8.Values)
cableconspacecount = Text(values_3.Values)

of_cable_groups = Integer(cablecount)
split = TextSplit(Text=cableconspacecount, Separators=",")
panel_2 = Panel()
of_constraint_sub_spaces_2 = Integer(split)
repeat = RepeatData(Data="Bake directional guides", Length=of_cable_groups)
repeat_2 = RepeatData(Data="Bake positional guides", Length=of_cable_groups)
series_2 = Series(Start=1, Step=1, Count=of_constraint_sub_spaces_2)
button_8 = CreateButton(ButtonName=repeat, ButtonStyle=0)
button_9 = CreateButton(ButtonName=repeat_2, ButtonStyle=0)
repeat_3 = RepeatData(Data="Delete cable", Length=of_cable_groups)
repeat_4 = RepeatData(Data="Show Highlight", Length=of_cable_groups)
repeat_5 = RepeatData(Data="Add cable", Length=of_cable_groups)
repeat_6 = RepeatData(Data="View cable twin", Length=of_cable_groups)
repeat_7 = RepeatData(Data="Message", Length=of_cable_groups)
repeat_8 = RepeatData(Data=panel_2, Length=of_cable_groups)
format_2 = Format(Format="View constraint subspace {0}", Culture=127, Data0=series_2)
merge_8 = Merge(Data1=graft(button_8), Data2=graft(button_9))
checklist_2 = CreateChecklist(ChecklistItems=format_2, Selected=False)  # -> flatten(Checklist)
button_10 = CreateButton(ButtonName=repeat_5, ButtonStyle=0)  # -> flatten(Button)
button_11 = CreateButton(ButtonName=repeat_3, ButtonStyle=0)  # -> flatten(Button)
checkbox = CreateCheckbox(Label=repeat_6, StartingValue=True)  # -> flatten(Checkbox)
checkbox_2 = CreateCheckbox(Label=repeat_4, StartingValue=False)  # -> flatten(Checkbox)
tb_3 = CreateTextBlock(Text=repeat_8, TextSize=12, Justification=0)  # -> flatten(TextBlock)
label_5 = CreateLabel(LabelText=repeat_7, LabelSize=12, Justification=0)  # -> flatten(Label)
wrappanel_3 = CreateWrapPanel(UIElements=merge_8, Horizontal=True)  # -> flatten(WrapPanel)
merge_9 = Merge(Data2=graft(button_10), Data3=graft(button_11), Data4=graft(checkbox), Data5=graft(checkbox_2))
wrappanel_4 = CreateWrapPanel(UIElements=merge_9, Horizontal=True)  # -> flatten(WrapPanel)
series_3 = Series(Start=1, Step=1, Count=of_cable_groups)
merge_10 = Merge(Data1=graft(wrappanel_4), Data2=graft(checklist_2), Data3=graft(wrappanel_3), Data4=graft(label_5), Data5=graft(tb_3))
format_3 = Format(Format="Group {0}", Culture=127, Data0=series_3)
expander_5 = CreateExpander(UIElements=merge_10, Header=graft(format_3), Open=False)  # -> flatten(Expander)
tb_4 = CreateTextBlock(Text="Waiting on step 1...", TextSize=12, Justification=0)
label_6 = CreateLabel(LabelText="Reconfiguration plan", LabelSize=12, Justification=0)
values_12 = ValueListener(Elements=merge_10, SomeProperty=True)  # -> Values, Indices
flip = FlipMatrix(Data=values_12.Values)
merge_11 = Merge(Data1=flatten(label_6), Data2=flatten(tb_4), Data3=flatten(expander_5))
mode_ui = Data(flip)

values_13 = ValueListener(Elements=button_10, SomeProperty=True)  # -> flatten(Values), Indices
values_14 = ValueListener(Elements=button_11, SomeProperty=True)  # -> flatten(Values), Indices
python_2 = GhPythonScript(input=values_13.Values)  # -> out, selId; inputs input: list
# ---------- python_2: Python ----------
__author__ = "MML"
__version__ = "2022.01.01"

import rhinoscriptsyntax as rs

if(True in input):
    selId = input.index(True)
else:
    selId = -1
# ---------- end python_2 ----------
python_3 = GhPythonScript(input=values_14.Values)  # -> out, selId; inputs input: list; same code as python_2
addcable = Integer(python_2.selId)
deletecable = Integer(python_3.selId)

expander_6 = CreateExpander(UIElements=merge_11, Header="Step 3: Tensioning cables", Open=False)
panel_3 = Panel("2,1,3")
panel_4 = Panel("C:/Users/MML/Desktop/recompfig/vis_tool.py")  # disabled
panel_5 = Panel("[('r', ((0.0, 1.0, 0.0), (0.0, 0.0, 1.0)), (0.0, 0.0, 0.0), ((0.0, 1.0, 0.0), (0.0, 0.0, 1.0)))]")  # disabled
panel_6 = Panel("((1, 0, 0), (0, 1, 0), (0, 0, 1))")
axial_space = AxialSpace()  # -> axes, spaces, frame
file_2 = ReadFile(File=python.visualizerPath, PerLineParse=False)
values_15 = ValueListener(Elements=colorpicker, SomeProperty=True)  # -> Values, Indices
pallette = GhPythonScript(colors=values_15.Values, alpha=Slider(70, range=0..255))  # -> out, rotClr, transClr, consClr, ocClr, rodClr, cableClr, twinClr, senClr, senTwinClr; inputs colors: list
# ---------- pallette: Python ----------
__author__ = "MML"
__version__ = "2022.01.03"

import rhinoscriptsyntax as rs
import System

c = []
for clr in colors:
    a = alpha
    r = clr.R
    g = clr.G
    b = clr.B
    newCol = System.Drawing.Color.FromArgb(a, r, g, b)
    c += [newCol]

colors = c

rotClr = colors[0]
transClr = colors[1]
consClr = colors[2]
ocClr = colors[3]
rodClr = colors[4]
cableClr = colors[5]
twinClr = colors[6]
senClr = colors[7]
senTwinClr = colors[8]
# ---------- end pallette ----------
file_3 = ReadFile(File=panel_4, PerLineParse=False)  # disabled
values_16 = ValueListener(Elements=button_2, SomeProperty=True)  # -> Values, Indices
visualizer = GhPythonScript(Code=file_3, Info=panel_5, RefAxes=axial_space.axes, RefSpaces=axial_space.spaces, RefFrames=axial_space.frame)  # -> Out, Spaces; disabled
geo = Geometry(visualizer.Spaces)  # disabled
preview = CustomPreview(Geometry=geo, Material=pallette.consClr)  # disabled
panel_7 = Panel(visualizer.Out)  # disabled
values_17 = ValueListener(Elements=button_6, SomeProperty=True)  # -> Values, Indices
values_18 = ValueListener(Elements=button_7, SomeProperty=True)  # -> Values, Indices
values_19 = ValueListener(Elements=button_8, SomeProperty=True)  # -> Values, Indices
values_20 = ValueListener(Elements=button_9, SomeProperty=True)  # -> Values, Indices

values_21 = ValueListener(Elements=button, SomeProperty=True)  # -> Values, Indices
selfreestage = Boolean(values_21.Values)

modecount_2 = Integer(modecount)
item = ListItem(List="Add a new mode", Index=modecount_2, Wrap=True)
tb_5 = CreateTextBlock(Text="Waiting on step 0...", TextSize=12, Justification=0)
button_12 = CreateButton(ButtonName="Reset", ButtonStyle=0)
button_13 = CreateButton(ButtonName=item, ButtonStyle=0)
label_7 = CreateLabel(LabelText="Message", LabelSize=12, Justification=0)
merge_12 = Merge(Data1=button_13, Data2=button_12)
pickbtn = CreateRhinoPickButton(
    ButtonName="Center point",
    Prompt="Select a point to center the visualizations around...",
    AllowMultiple=False,
    AllowNone=True,
    Type=4,
    ButtonStyle=0)
button_14 = CreateButton(ButtonName="Select base(fixed) stages", ButtonStyle=0)
stack = CreateStack(UIElements=merge_12, Horizontal=True)
merge_13 = Merge(Data1=pickbtn, Data2=button_14, Data3=button)
wrappanel_5 = CreateWrapPanel(UIElements=merge_13, Horizontal=True)
label_8 = CreateLabel(LabelText="Message", LabelSize=12, Justification=0)
panel_8 = Panel()
split_2 = TextSplit(Text=modefreespacecount, Separators=",")
of_constraint_sub_spaces_3 = Integer(split_2)
repeat_9 = RepeatData(Data="Message", Length=modecount_2)
repeat_10 = RepeatData(Data=panel_8, Length=modecount_2)
repeat_11 = RepeatData(Data="Add rotation", Length=modecount_2)
repeat_12 = RepeatData(Data="Add translation", Length=modecount_2)
tb_6 = CreateTextBlock(Text=repeat_10, TextSize=12, Justification=0)  # -> flatten(TextBlock)
label_9 = CreateLabel(LabelText=repeat_9, LabelSize=12, Justification=0)  # -> flatten(Label)
button_15 = CreateButton(ButtonName=repeat_11, ButtonStyle=0)
button_16 = CreateButton(ButtonName=repeat_12, ButtonStyle=0)
series_4 = Series(Start=1, Step=1, Count=of_constraint_sub_spaces_3)
repeat_13 = RepeatData(Data="Goals", Length=modecount_2)
repeat_14 = RepeatData(Data="Delete mode", Length=modecount_2)
merge_14 = Merge(Data1=graft(button_15), Data2=graft(button_16))
format_4 = Format(Format="View freedom subspace {0}", Culture=127, Data0=series_4)
checklist_3 = CreateChecklist(ChecklistItems=format_4, Selected=False)  # -> flatten(Checklist)
tb_7 = CreateTextBlock(Text=repeat_13, TextSize=12, Justification=0)  # -> flatten(TextBlock)
button_17 = CreateButton(ButtonName=repeat_14, ButtonStyle=0)  # -> flatten(Button)
stack_2 = CreateStack(UIElements=merge_14, Horizontal=True)  # -> flatten(Stack)
merge_15 = Merge(
    Data1=graft(button_17),
    Data2=graft(tb_7),
    Data3=graft(stack_2),
    Data4=graft(checklist_3),
    Data5=graft(label_9),
    Data6=graft(tb_6))
series_5 = Series(Start=1, Step=1, Count=modecount_2)
format_5 = Format(Format="Mode {0}", Culture=127, Data0=series_5)
expander_7 = CreateExpander(UIElements=merge_15, Header=graft(format_5), Open=False)  # -> flatten(Expander)
values_22 = ValueListener(Elements=merge_15, SomeProperty=True)  # -> Values, Indices
flip_2 = FlipMatrix(Data=values_22.Values)
mode_ui_2 = Data(flip_2)

values_23 = ValueListener(Elements=button_14, SomeProperty=True)  # -> Values, Indices
values_24 = ValueListener(Elements=button_12, SomeProperty=True)  # -> Values, Indices
values_25 = ValueListener(Elements=button_13, SomeProperty=True)  # -> Values, Indices
values_26 = ValueListener(Elements=button_17, SomeProperty=True)  # -> flatten(Values), Indices
values_27 = ValueListener(Elements=button_15, SomeProperty=True)  # -> flatten(Values), Indices
values_28 = ValueListener(Elements=button_16, SomeProperty=True)  # -> flatten(Values), Indices
python_4 = GhPythonScript(input=values_26.Values)  # -> out, selId; inputs input: list; same code as python_2
python_5 = GhPythonScript(input=values_27.Values)  # -> out, selId; inputs input: list; same code as python_2
python_6 = GhPythonScript(input=values_28.Values)  # -> out, selId; inputs input: list; same code as python_2
resetall = Boolean(values_24.Values)
addmode = Boolean(values_25.Values)
deletemode = Integer(python_4.selId)
addrotation = Integer(python_5.selId)
addtranslation = Integer(python_6.selId)
selbasestage = Boolean(values_23.Values)

tb_8 = CreateTextBlock(Text="Waiting on step 0...", TextSize=12, Justification=0)

merge_16 = Merge(Data1=wrappanel_5, Data2=label_8, Data3=tb_8, Data4=stack, Data5=label_7, Data6=tb_5, Data7=expander_7)

settextblock_2 = SetTextBlockContents(TextBlockToModify=tb_5, NewTextBlockContents=python.msgStep1)

values_29 = ValueListener(Elements=pickbtn, SomeProperty=True)  # -> Values, Indices
pt = Point(values_29.Values)
python_7 = GhPythonScript(pt=pt)  # -> out, pt
# ---------- python_7: Python ----------
__author__ = "MML"
__version__ = "2022.01.02"

import rhinoscriptsyntax as rs

if(pt):
    pt = str(tuple(rs.coerce3dpoint(pt)))
else:
    pt = "None"
# ---------- end python_7 ----------

expander_8 = CreateExpander(UIElements=merge_16, Header="Step 1: Kinematic modes", Open=False)
panel_9 = Panel(python_7.pt)

sensorcount_2 = Integer(sensorcount)
split_3 = TextSplit(Text=sensorconspacecount, Separators=",")
panel_10 = Panel()
of_constraint_sub_spaces_4 = Integer(split_3)
repeat_15 = RepeatData(Data="Bake directional guides", Length=sensorcount_2)
repeat_16 = RepeatData(Data="Bake positional guides", Length=sensorcount_2)
series_6 = Series(Start=1, Step=1, Count=of_constraint_sub_spaces_4)
repeat_17 = RepeatData(Data="Delete sensor", Length=sensorcount_2)
repeat_18 = RepeatData(Data="Add sensor", Length=sensorcount_2)
repeat_19 = RepeatData(Data="View sensor twin", Length=sensorcount_2)
repeat_20 = RepeatData(Data="Message", Length=sensorcount_2)
repeat_21 = RepeatData(Data=panel_10, Length=sensorcount_2)
button_18 = CreateButton(ButtonName=repeat_15, ButtonStyle=0)
button_19 = CreateButton(ButtonName=repeat_16, ButtonStyle=0)
format_6 = Format(Format="View constraint subspace {0}", Culture=127, Data0=series_6)
merge_17 = Merge(Data1=graft(button_18), Data2=graft(button_19))
checklist_4 = CreateChecklist(ChecklistItems=format_6, Selected=False)  # -> flatten(Checklist)
button_20 = CreateButton(ButtonName=repeat_18, ButtonStyle=0)  # -> flatten(Button)
button_21 = CreateButton(ButtonName=repeat_17, ButtonStyle=0)  # -> flatten(Button)
checkbox_3 = CreateCheckbox(Label=repeat_19, StartingValue=True)  # -> flatten(Checkbox)
tb_9 = CreateTextBlock(Text=repeat_21, TextSize=12, Justification=0)  # -> flatten(TextBlock)
label_10 = CreateLabel(LabelText=repeat_20, LabelSize=12, Justification=0)  # -> flatten(Label)
wrappanel_6 = CreateWrapPanel(UIElements=merge_17, Horizontal=True)  # -> flatten(WrapPanel)
series_7 = Series(Start=1, Step=1, Count=sensorcount_2)
format_7 = Format(Format="Group {0}", Culture=127, Data0=series_7)
tb_10 = CreateTextBlock(Text="Waiting on step 0...", TextSize=12, Justification=0)
label_11 = CreateLabel(LabelText="Sensor group responsiveness", LabelSize=12, Justification=0)

values_30 = ValueListener(Elements=button_20, SomeProperty=True)  # -> flatten(Values), Indices
values_31 = ValueListener(Elements=button_21, SomeProperty=True)  # -> flatten(Values), Indices
python_8 = GhPythonScript(input=values_30.Values)  # -> out, selId; inputs input: list; same code as python_2
python_9 = GhPythonScript(input=values_31.Values)  # -> out, selId; inputs input: list; same code as python_2
addsensor = Integer(python_8.selId)
deletesensor = Integer(python_9.selId)

merge_18 = Merge(Data1=graft(label_10), Data2=graft(tb_9))
wrappanel_7 = CreateWrapPanel(UIElements=merge_18, Horizontal=True)  # -> flatten(WrapPanel)
modeler = GhPythonScript(
    CM=compmechcore.CM,
    resetModes=resetall,
    selBaseStage=selbasestage,
    selFreeStage=selfreestage,
    addMode=addmode,
    delMode=deletemode,
    addRot=addrotation,
    addTrans=addtranslation,
    resetRod=resetrod,
    addRod=addrod,
    delRod=deleterod,
    addCab=addcable,
    delCab=deletecable,
    addSen=addsensor,
    delSen=deletesensor)  # -> out, CM
# ---------- modeler: Python ----------
__author__ = "humphreyyang"

modeCount = []
sensorCount = []

ran = True
# modes
if(resetModes):
    CM.resetModes()
    modeCount = CM.modeCount
elif(selBaseStage):
    CM.addBaseStage()
elif(selFreeStage):
    CM.addFreeStage()
elif(addMode):
    CM.addMode()
elif(delMode != None and delMode != -1):
    CM.delMode(delMode)
elif(addRot != None and addRot != -1):
    CM.addGoalRot(addRot)
elif(addTrans != None and addTrans != -1):
    CM.addGoalTrans(addTrans)
# flexures
elif(resetRod):
    CM.resetRod()
elif(addRod):
    CM.addRod()
elif(delRod):
    CM.delRod()
# cables
elif(addCab != None and addCab != -1):
    CM.addCab(addCab)
elif(delCab != None and delCab != -1):
    CM.delCab(delCab)
    
elif(addSen != None and addSen != -1):
    CM.addSen(addSen)
elif(delSen != None and delSen != -1):
    CM.delSen(delSen)
else:
    ran = False

CM = CM
if(CM):
    CM.printInfo()
# ---------- end modeler ----------
messenger = GhPythonScript(CM=modeler.CM)  # -> out, msgStages
# ---------- messenger: Python ----------
__author__ = "MML"
__version__ = "2022.01.01"

import rhinoscriptsyntax as rs

if(CM):
    msgStages = CM.msgStages
# ---------- end messenger ----------
python_10 = GhPythonScript(CM=modeler.CM)  # -> out, a
# ---------- python_10: Python ----------
__author__ = "MML"
__version__ = "2022.04.26"

import rhinoscriptsyntax as rs

print(CM.modeCount)
# ---------- end python_10 ----------
model = GhPythonScript(CM=modeler.CM)  # -> out, CM, info
# ---------- model: Python ----------
__author__ = "MML"
__version__ = "2022.01.02"

info = []

if(CM):
    CM.createModel()
    info = CM.outputInfo()

CM= CM
# ---------- end model ----------
setlabel = SetLabelContents(LabelToModify=tb_8, NewLabelContents=messenger.msgStages)
settextblock_3 = SetTextBlockContents(TextBlockToModify=tb_8, NewTextBlockContents=messenger.msgStages)
panel_11 = Panel(model.info)
gh_cpython = GH_CPython(folderPath=python.folderPath, inputModel=model.info, viewCenter=python_7.pt)  # -> info, messages, bases; inputs folderPath: list, inputModel: list, viewCenter: list
# ---------- gh_cpython: Python ----------
# -*- coding: utf-8 -*-
""" 
Python Script
Created on  Sunday January 2022 03:36:32 
@author:  MML 

[desc]
Description of the plugin Here
Write here any thing... 
[/desc]

ARGUMENTS:
----------
<inp> 
    folderPath :[required] - [type = string] - [default = None] 
    Describe your input here 
        * bullet point.
        * bullet point
</inp>

<inp>
    inputModel:[required] - [type = string] - [default = None] 
    Describe your input here 
        * bullet point.
        * bullet point
</inp>

<inp>
    viewCenter:[required] - [type = string] - [default = None] 
    Describe your input here 
        * bullet point.
        * bullet point
</inp>

RETURN:
----------
    <out>
        output_ : indicate your output description here. \n refers to a new line.
    </out>

"""
if(folderPath != None):
    import sys
    sys.path.append(folderPath)
    from model import CompMechSimp

    info = [] 
    messages = []

    m = CompMechSimp(inputModel, viewCenter)
    info = str(m.computeDesign())
    messages = str(m.outputMsg())
    bases = str(m.outputBases())
# ---------- end gh_cpython ----------
postproc = GhPythonScript(CM=model.CM, info=gh_cpython.info, messages=gh_cpython.messages, bases=gh_cpython.bases)  # -> out, CM, info, messages, bases
# ---------- postproc: Python ----------
__author__ = "MML"
__version__ = "2022.01.03"

import rhinoscriptsyntax as rs

info = eval(info)
messages = eval(messages)
bases = eval(bases)

if(info == None):
    info = []
if(messages == None):
    messages = []
if(bases == None):
    bases = []

if(len(info) > 0):
    cableGroupCount = len(info[2][1])
    if(CM): CM.setCableGroupCount(cableGroupCount)
    
    CM.conSubspaceCount = len(info[1][1])
    
    CM.modeFreeSpaceCount = ','.join([str(len(spaces)) for spaces in info[0]])
    
    CM.cableConSpaceCount = ','.join([str(len(spaces)) for spaces in info[2][2]])
    
    CM.sensorConSpaceCount = ','.join([str(len(spaces)) for spaces in info[3][1]])
# ---------- end postproc ----------
promptreader = GhPythonScript(CM=postproc.CM, messages=postproc.messages)  # -> out, step1Overall, step1Indi, step2Overall, step3ConfigPlan, step3Indi, step4Overall, step4Indi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; inputs messages: list
# ---------- promptreader: Python ----------
__author__ = "MML"
__version__ = "2022.01.03"

if(len(messages) != 0):
    step1Overall = messages[0][0]
    
    step1Indi = list(messages[0][1])
    if(len(step1Indi) < CM.modeCount):
        step1Indi += [""] * (CM.modeCount - len(step1Indi))
        
    step2Overall = messages[1]
    
    step3ConfigPlan = messages[2][0]
    step3Indi = messages[2][1]
    step4Overall = messages[3][0]
    step4Indi = messages[3][1]
    finalRod = messages[4][0]
    finalCable = messages[4][1]
    finalSensor = messages[4][2]
# ---------- end promptreader ----------
visualizer_2 = GhPythonScript(
    Code=file_2,
    IconPath=python.iconPath,
    CM=postproc.CM,
    Info=postproc.info,
    DispCenter=pt,
    Bases=postproc.bases,
    RefAxes=axial_space.axes,
    RefSpaces=axial_space.spaces,
    RefFrames=axial_space.frame)  # -> Out, Rods, Cables, CableTwins, Sensors, SensorTwins, Step1Vis, Step2OC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

image = CreateImage(ImageSource=visualizer_2.IconFiles, ImageWidth=300)
grid = CreateGrid(UIElements=image, ElementRowSpan=1, ElementColumnSpan=1)  # -> flatten(Grid)
merge_19 = Merge(Data1=graft(grid), Data2=graft(button_20), Data3=graft(button_21), Data4=graft(checkbox_3))
wrappanel_8 = CreateWrapPanel(UIElements=merge_19, Horizontal=True)
merge_20 = Merge(Data1=wrappanel_8, Data2=graft(checklist_4), Data3=graft(wrappanel_6), Data4=graft(wrappanel_7))
expander_9 = CreateExpander(UIElements=merge_20, Header=graft(format_7), Open=False)  # -> flatten(Expander)
values_32 = ValueListener(Elements=merge_20, SomeProperty=True)  # -> Values, Indices
flip_3 = FlipMatrix(Data=values_32.Values)
merge_21 = Merge(Data1=label_11, Data2=tb_10, Data3=expander_9)
mode_ui_3 = Data(flip_3)

panel_12 = Panel(image)
expander_10 = CreateExpander(UIElements=merge_21, Header="Step 4: Stretchable sensors", Open=False)
modelbaker = GhPythonScript(rods=visualizer_2.RodsBake, cables=visualizer_2.CablesBake, sensors=visualizer_2.SensorsBake, bake=values_16.Values)  # -> out, a; inputs rods: tree, cables: tree, sensors: tree
# ---------- modelbaker: Python ----------
__author__ = "MML"
__version__ = "2022.01.04"

import rhinoscriptsyntax as rs
import scriptcontext as sc
import Rhino

def checkCreateLayer(name, setCurrent=True, parent=None):
    
    sc.doc = Rhino.RhinoDoc.ActiveDoc
    
    if(not rs.IsLayer(name)):
        rs.AddLayer(name, parent=parent)
    
    if(setCurrent):
        rs.CurrentLayer(name)
    
    sc.doc = ghdoc

def bakeObj(item):
    
    sc.doc = ghdoc
    geo = rs.coercegeometry(item)
    sc.doc = Rhino.RhinoDoc.ActiveDoc
    rs.CopyObject(geo)
    sc.doc = ghdoc

if(bake):
    sc.doc = Rhino.RhinoDoc.ActiveDoc
    original = rs.CurrentLayer()
    sc.doc = ghdoc
    
    # rods
    rodsLayer = "rodsCenterLine"
    checkCreateLayer(rodsLayer)
    
    for path in rods.Paths:
        branch = rods.Branch(path)
        for rod in branch:
            bakeObj(rod)
    
    # cables
    cablesLayer = "cablesCenterLine"
    checkCreateLayer(cablesLayer)
    
    for path in cables.Paths:
        branch = cables.Branch(path)
        groupLayer = "cGroup%d" % path[0]
        checkCreateLayer(groupLayer, parent=cablesLayer)
        for cable in branch:
            bakeObj(cable)
    
    # sensors
    sensorsLayer = "sensorsCenterLine"
    checkCreateLayer(sensorsLayer)
    
    for path in sensors.Paths:
        branch = sensors.Branch(path)
        groupLayer = "sGroup%d" % path[0]
        checkCreateLayer(groupLayer, parent=sensorsLayer)
        for sensor in branch:
            bakeObj(sensor)
    
    # reinstate current layer
    
    sc.doc = Rhino.RhinoDoc.ActiveDoc
    rs.CurrentLayer(original)
    sc.doc = ghdoc
# ---------- end modelbaker ----------

values_33 = ValueListener(Elements=checklist, SomeProperty=True)  # -> graft(Values), Indices
dispatch = Dispatch(List=visualizer_2.Step2ConSpace, DispatchPattern=values_33.Values)  # -> ListA, ListB
preview_2 = CustomPreview(Geometry=dispatch.ListA, Material=pallette.consClr)

values_34 = ValueListener(Elements=checkbox_2, SomeProperty=True)  # -> graft(Values), Indices
dispatch_2 = Dispatch(List=visualizer_2.Step3Highlight, DispatchPattern=values_34.Values)  # -> ListA, ListB
preview_3 = CustomPreview(Geometry=dispatch_2.ListA, Material=pallette.rotClr)

values_35 = ValueListener(Elements=checklist_2, SomeProperty=True)  # -> graft(Values), Indices
dispatch_3 = Dispatch(List=visualizer_2.Step3ConSpace, DispatchPattern=values_35.Values)  # -> ListA, ListB
preview_4 = CustomPreview(Geometry=dispatch_3.ListA, Material=pallette.consClr)

values_36 = ValueListener(Elements=checklist_3, SomeProperty=True)  # -> graft(Values), Indices
dispatch_4 = Dispatch(List=visualizer_2.Step1Vis, DispatchPattern=values_36.Values)  # -> ListA, ListB
preview_5 = CustomPreview(Geometry=dispatch_4.ListA, Material=pallette.rotClr)

values_37 = ValueListener(Elements=checklist_4, SomeProperty=True)  # -> graft(Values), Indices
dispatch_5 = Dispatch(List=visualizer_2.Step4ConSpace, DispatchPattern=values_37.Values)  # -> ListA, ListB
preview_6 = CustomPreview(Geometry=dispatch_5.ListA, Material=pallette.consClr)

values_38 = ValueListener(Elements=checkbox_3, SomeProperty=True)  # -> graft(Values), Indices
dispatch_6 = Dispatch(List=visualizer_2.SensorTwins, DispatchPattern=values_38.Values)  # -> ListA, ListB
preview_7 = CustomPreview(Geometry=dispatch_6.ListA, Material=pallette.senTwinClr)

values_39 = ValueListener(Elements=checkbox, SomeProperty=True)  # -> graft(Values), Indices
dispatch_7 = Dispatch(List=visualizer_2.CableTwins, DispatchPattern=values_39.Values)  # -> ListA, ListB
preview_8 = CustomPreview(Geometry=dispatch_7.ListA, Material=pallette.twinClr)

preview_9 = CustomPreview(Geometry=visualizer_2.Sensors, Material=pallette.senClr)
preview_10 = CustomPreview(Geometry=visualizer_2.Rods, Material=pallette.rodClr)
preview_11 = CustomPreview(Geometry=visualizer_2.Cables, Material=pallette.cableClr)
preview_12 = CustomPreview(Geometry=visualizer_2.Step2OC, Material=pallette.ocClr)
preview_13 = CustomPreview(Geometry=visualizer_2.Step3OC, Material=pallette.ocClr)
values_40 = ValueListener(Elements=button_18, SomeProperty=True)  # -> Values, Indices
values_41 = ValueListener(Elements=button_19, SomeProperty=True)  # -> Values, Indices
dispatch_8 = Dispatch(List=visualizer_2.Step4DirGuide, DispatchPattern=values_37.Values)  # -> ListA, ListB
dispatch_9 = Dispatch(List=visualizer_2.Step4PosGuide, DispatchPattern=values_37.Values)  # -> ListA, ListB
dispatch_10 = Dispatch(List=visualizer_2.Step3DirGuide, DispatchPattern=values_35.Values)  # -> ListA, ListB
dispatch_11 = Dispatch(List=visualizer_2.Step3PosGuide, DispatchPattern=values_35.Values)  # -> ListA, ListB
dispatch_12 = Dispatch(List=visualizer_2.Step2DirGuide, DispatchPattern=values_33.Values)  # -> ListA, ListB
dispatch_13 = Dispatch(List=visualizer_2.Step2PosGuide, DispatchPattern=values_33.Values)  # -> ListA, ListB
trim = TrimTree(Tree=dispatch_10.ListA, Depth=1)
trim_2 = TrimTree(Tree=dispatch_11.ListA, Depth=1)
trim_3 = TrimTree(Tree=dispatch_8.ListA, Depth=1)
trim_4 = TrimTree(Tree=dispatch_9.ListA, Depth=1)
guidebaker = GhPythonScript(
    s2Dir=dispatch_12.ListA,
    s2Pos=dispatch_13.ListA,
    s3Dir=trim,
    s3Pos=trim_2,
    s4Dir=trim_3,
    s4Pos=trim_4,
    s2DirBake=values_17.Values,
    s2PosBake=values_18.Values,
    s3DirBake=values_19.Values,
    s3PosBake=values_20.Values,
    s4DirBake=values_40.Values,
    s4PosBake=values_41.Values)  # -> out; inputs s2Dir: tree, s2Pos: tree, s3Dir: tree, s3Pos: tree, s4Dir: tree, s4Pos: tree, s3DirBake: tree, s3PosBake: tree, s4DirBake: tree, s4PosBake: tree
# ---------- guidebaker: Python ----------
__author__ = "MML"
__version__ = "2022.01.04"

import rhinoscriptsyntax as rs
import scriptcontext as sc
import Rhino

guidesLayer = "modelingGuides"

def checkCreateLayer(name, setCurrent=True, parent=None):
    
    sc.doc = Rhino.RhinoDoc.ActiveDoc
    
    if(not rs.IsLayer(name)):
        rs.AddLayer(name, parent=parent)
    
    if(setCurrent):
        rs.CurrentLayer(name)
    
    sc.doc = ghdoc

def bakeObj(item):
    
    sc.doc = ghdoc
    geo = rs.coercegeometry(item)
    sc.doc = Rhino.RhinoDoc.ActiveDoc
    rs.CopyObject(geo)
    sc.doc = ghdoc

def bakeAll(tree, masks=None):
    
    for path in tree.Paths:
        branch = tree.Branch(path)
        if(masks != None):
            print(masks.Branch(path)[0])
        if(masks != None and not masks.Branch(path)[0]): continue
        for item in branch:
            bakeObj(item)
        

sc.doc = Rhino.RhinoDoc.ActiveDoc
original = rs.CurrentLayer()
sc.doc = ghdoc

checkCreateLayer(guidesLayer)

# rods
if(s2DirBake):
    bakeAll(s2Dir)
if(s2PosBake):
    bakeAll(s2Pos)

# cables
if(True in s3DirBake.AllData()):
    bakeAll(s3Dir, s3DirBake)
if(True in s3PosBake.AllData()):
    bakeAll(s3Pos, s3PosBake)

# sensors
if(True in s4DirBake.AllData()):
    bakeAll(s4Dir, s4DirBake)
if(True in s4PosBake.AllData()):
    bakeAll(s4Pos, s4PosBake)

# reinstate current layer
sc.doc = Rhino.RhinoDoc.ActiveDoc
rs.CurrentLayer(original)
sc.doc = ghdoc
# ---------- end guidebaker ----------

tb_11 = CreateTextBlock(Text="Waiting on step 1...", TextSize=12, Justification=0)
label_12 = CreateLabel(LabelText="Sensor response", LabelSize=12, Justification=0)
label_13 = CreateLabel(LabelText="Message", LabelSize=12, Justification=0)
label_14 = CreateLabel(LabelText="Reconfiguration plan", LabelSize=12, Justification=0)

tb_12 = CreateTextBlock(Text="Waiting on step 3...", TextSize=12, Justification=0)
tb_13 = CreateTextBlock(Text="Waiting on step 1...", TextSize=12, Justification=0)

merge_22 = Merge(
    Data1=flatten(label_13),
    Data2=flatten(tb_12),
    Data3=flatten(label_14),
    Data4=flatten(tb_13),
    Data5=flatten(label_12),
    Data6=flatten(tb_11),
    Data7=flatten(button_2))

expander_11 = CreateExpander(UIElements=merge_22, Header="Step 5: Finalize", Open=False)

merge_23 = Merge(
    Data1=tb,
    Data2=tb_8,
    Data3=tb_5,
    Data4=tb_6,
    Data5=tb_2,
    Data6=tb_4,
    Data7=tb_3,
    Data8=tb_10,
    Data9=tb_9,
    Data10=tb_12,
    Data11=tb_13,
    Data12=tb_11)
adjustelem = AdjustElementAppearance(ElementsToAdjust=merge_23, Background=ColourSwatch(SwatchColor=RGB(255, 255, 255)))

merge_24 = Merge(
    Data1=expander,
    Data2=expander_8,
    Data3=expander_4,
    Data4=expander_6,
    Data5=expander_10,
    Data6=expander_11,
    Data7=expander_2,
    Data8=expander_3)
values_42 = ValueListener(Elements=merge_24, SomeProperty=True)  # -> flatten(Values), Indices
windowset = GhPythonScript(
    CM=postproc.CM,
    modeCountIn=modecount,
    sensorCountIn=sensorcount,
    conSubspaceCountIn=subspacecount,
    cableGroupCountIn=cablecount,
    modeFreeSpaceCountIn=modefreespacecount,
    cableConSpaceCountIn=cableconspacecount,
    sensorConSpaceCountIn=sensorconspacecount,
    windowMode=values_42.Values)  # -> out, modeCountSet, sensorCountSet, conSubspaceCountSet, cableGroupCountSet, modeFreeSpaceCountSet, cableConSpaceCountSet, sensorConSpaceCountSet, setWindowMode; inputs windowMode: list
# ---------- windowset: Python ----------
__author__ = "MML"
__version__ = "2022.01.01"

import rhinoscriptsyntax as rs

def isWindowModeSame(subject, target):
    
    for i in range(len(subject)):
        if(subject[i] != target[i]):
            return False
    
    return True

modeCountSet = []
sensorCountSet = []
setWindowMode = []
conSubspaceCountSet = []
cableGroupCountSet = []
modeFreeSpaceCountSet = []
cableConSpaceCountSet = []
sensorConSpaceCountSet = []

if(CM != None):
    
    idle = True
    if(modeCountIn != CM.modeCount):
        if(CM.snapShot == None):
            CM.snapShot = windowMode
            print(CM.snapShot)
        modeCountSet = CM.modeCount
        idle = False
    if(sensorCountIn != CM.sensorCount):
        if(CM.snapShot == None):
            CM.snapShot = windowMode
        sensorCountSet = CM.sensorCount 
        idle = False
    if(cableGroupCountIn != CM.cableGroupCount):
        if(CM.snapShot == None):
            CM.snapShot = windowMode
        cableGroupCountSet = CM.cableGroupCount
        idle = False
    if(conSubspaceCountIn != CM.conSubspaceCount):
        if(CM.snapShot == None):
            CM.snapShot = windowMode
        conSubspaceCountSet = CM.conSubspaceCount
        idle = False
    if(modeFreeSpaceCountIn != CM.modeFreeSpaceCount):
        if(CM.snapShot == None):
            CM.snapShot = windowMode
        modeFreeSpaceCountSet = CM.modeFreeSpaceCount
        idle = False
    if(cableConSpaceCountIn != CM.cableConSpaceCount):
        if(CM.snapShot == None):
            CM.snapShot = windowMode
        cableConSpaceCountSet = CM.cableConSpaceCount
        idle = False
    if(sensorConSpaceCountIn != CM.sensorConSpaceCount):
        if(CM.snapShot == None):
            CM.snapShot = windowMode
        sensorConSpaceCountSet = CM.sensorConSpaceCount
        idle = False

    if(idle and CM.snapShot != None and not isWindowModeSame(windowMode, CM.snapShot)):
        setWindowMode = CM.snapShot
    elif(idle and CM.snapShot != None and isWindowModeSame(windowMode, CM.snapShot)):
        CM.snapShot = None
"""
print("In", "CM", "Set")
print("modeCount", modeCountIn, CM.modeCount, modeCountSet)
print("sensorCount", sensorCountIn, CM.sensorCount, sensorCountSet)
print("cableGroupCount", cableGroupCountIn, CM.cableGroupCount, cableGroupCountSet)
print("conSubspaceCount", conSubspaceCountIn, CM.conSubspaceCount, conSubspaceCountSet)
print("modeFreeSpaceCount", modeFreeSpaceCountIn, CM.modeFreeSpaceCount, modeFreeSpaceCountSet)
print("cableConSpaceCount", cableConSpaceCountIn, CM.cableConSpaceCount, cableConSpaceCountSet)
print(idle)
print(CM.snapShot)
print()
"""
# ---------- end windowset ----------

accent_colors = ValueList({"Amber", "Blue", "Brown", "Cobalt", "Crimson", "Cyan", "Emerald", "Green", "Indigo", "Lime", "Magenta", "Mauve", "Olive", "Orange", "Pink", "Purple", "Red", "Sienna", "Steel", "Taupe", "Teal", "Violet", "Yellow", "Black": "Grey"}, selected="Orange")
launchwin = LaunchWindow(
    Show=Button(ExpressionNormal="True", ExpressionPressed="False"),
    Name="ReCompFig",
    Width=370,
    Height=800,
    FontFamily="Courier New",
    ChildStatus=2,
    EnableHorizScroll=False)
addelems = AddElements(Window=launchwin, Elements=flatten(merge_24), DoVLChecking=True)  # -> AddedElements, ElementNames
winprops = SetWindowProperties(
    Window=launchwin,
    Theme=0,
    AccentColor=accent_colors,
    ShowTitleBar=True,
    BackgroundColor=ColourSwatch(SwatchColor=RGB(171, 171, 171)),
    ScaleFactor=1)

settextbox = SetTextBoxContents(TextBoxToModify=textbox_2, NewTextBoxContents=windowset.modeCountSet)
settextbox_2 = SetTextBoxContents(TextBoxToModify=textbox_4, NewTextBoxContents=windowset.sensorCountSet)
settextbox_3 = SetTextBoxContents(TextBoxToModify=textbox, NewTextBoxContents=windowset.conSubspaceCountSet)
settextbox_4 = SetTextBoxContents(TextBoxToModify=textbox_3, NewTextBoxContents=windowset.cableGroupCountSet)
settextbox_5 = SetTextBoxContents(TextBoxToModify=textbox_7, NewTextBoxContents=windowset.modeFreeSpaceCountSet)
settextbox_6 = SetTextBoxContents(TextBoxToModify=textbox_5, NewTextBoxContents=windowset.cableConSpaceCountSet)
settextbox_7 = SetTextBoxContents(TextBoxToModify=textbox_6, NewTextBoxContents=windowset.sensorConSpaceCountSet)
setexp = SetExpander(Expander=merge_24, ExpandedOpen=windowset.setWindowMode)

settextblock_4 = SetTextBlockContents(TextBlockToModify=tb_5, NewTextBlockContents=promptreader.step1Overall)
settextblock_5 = SetTextBlockContents(TextBlockToModify=tb_6, NewTextBlockContents=promptreader.step1Indi)
settextblock_6 = SetTextBlockContents(TextBlockToModify=tb_2, NewTextBlockContents=promptreader.step2Overall)
settextblock_7 = SetTextBlockContents(TextBlockToModify=tb_4, NewTextBlockContents=promptreader.step3ConfigPlan)
settextblock_8 = SetTextBlockContents(TextBlockToModify=tb_3, NewTextBlockContents=promptreader.step3Indi)
settextblock_9 = SetTextBlockContents(TextBlockToModify=tb_10, NewTextBlockContents=promptreader.step4Overall)
settextblock_10 = SetTextBlockContents(TextBlockToModify=tb_9, NewTextBlockContents=promptreader.step4Indi)
settextblock_11 = SetTextBlockContents(TextBlockToModify=tb_12, NewTextBlockContents=promptreader.finalRod)
settextblock_12 = SetTextBlockContents(TextBlockToModify=tb_13, NewTextBlockContents=promptreader.finalCable)
settextblock_13 = SetTextBlockContents(TextBlockToModify=tb_11, NewTextBlockContents=promptreader.finalSensor)

# ==== cluster AxialSpace
number_slider = Slider(108, range=0..1000)
pt = Point(Point(-149, -228, 0))
arrows = Curve([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])
blades = Surface([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])
line = Curve([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])
point = Point([Point(-95, -282, 0), Point(13, -282, 0), Point(121, -282, 0)])
plane = Surface([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])
box = Brep(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)
neg = Negative(Value=number_slider)
box_2 = Box(box)
series = Series(Start=0, Step=number_slider, Count=3)
series_2 = Series(Start=0, Step=neg, Count=4)
X = UnitX(Factor=series)
python = GhPythonScript(arrows=arrows, blades=blades, points=point, lines=line, planes=plane, boxes=box_2)  # -> out, axes, shapes; inputs arrows: list, blades: list, points: list, lines: list, planes: list, boxes: list
# ---------- python: Python ----------
__author__ = "MorphingMatterLab"
__version__ = "2020.08.16"

import rhinoscriptsyntax as rs
from Grasshopper import DataTree
from Grasshopper.Kernel.Data import GH_Path as treePath
from Rhino.Geometry import GeometryBase

SCALE = 20
EPSILON = 1e-6
colorCode = {'r':0, 't':1, 'c':2}

class ViewContainer(object):
    def __init__(self):
        self.axes = []
        self.spaces = []
        self.axesLines = []
    
    def addAxes(self, obj):
        self.axes += [obj]
    
    def addSpaces(self, obj):
        self.spaces += [obj]
    
    def addLine(self, obj):
        self.axesLines += [obj]

vc = ViewContainer()

def drawArrow(anchor, vec):
    
    height = 2
    dia = 1
    
    end = rs.VectorAdd(anchor, vec)
    pipe = rs.AddPipe(rs.AddLine(anchor, end), 0, dia / 4, cap=1)
    apex = rs.VectorAdd(end, rs.VectorScale(rs.VectorUnitize(vec), height))
    plane = rs.PlaneFromNormal(apex, -vec)
    
    cone = rs.AddCone(plane, height, dia)
    arrow = rs.BooleanUnion(pipe + [cone])
    
    return arrow[0]

def drawRotAxis(line):
    
    height = 2
    dia = 1
    arcDeg = 240
    rotation = (360 - arcDeg) / 2
    arcRad = 4
    
    start = rs.CurveStartPoint(line) 
    mid = rs.CurveMidPoint(line)
    end = rs.CurveEndPoint(line)
    vec = rs.VectorUnitize(rs.VectorSubtract(end, start))
    
    axisPipe = rs.AddPipe(line, 0, dia / 4, cap=2)
    arcPlane = rs.RotatePlane(rs.PlaneFromNormal(mid, vec), rotation, vec)
    arc = rs.AddArc(arcPlane, arcRad, arcDeg)
    arcPipe = rs.AddPipe(arc, 0, dia / 4, cap=1)
    
    arcDom = rs.CurveDomain(arc)
    tangStart = rs.CurveTangent(arc, arcDom[0])
    tangEnd   = rs.CurveTangent(arc, arcDom[1]) * -1
    arcStart = rs.CurveStartPoint(arc)
    arcEnd = rs.CurveEndPoint(arc)
    
    planeStart = rs.PlaneFromNormal(arcStart - tangStart, tangStart)
    planeEnd = rs.PlaneFromNormal(arcEnd - tangEnd, tangEnd)
    coneStart = rs.AddCone(planeStart, height, dia)
    coneEnd = rs.AddCone(planeEnd, height, dia)
    arcArrow = rs.BooleanUnion(arcPipe + [coneStart, coneEnd])
    
    return arcArrow + axisPipe

def drawPointSpace(refPt, spanVecs):
    
    return rs.AddPoint(refPt)

def drawLineSpace(refPt, spanVecs):
    
    span0 = spanVecs[0]
    pt0 = rs.VectorAdd(refPt, rs.VectorScale(span0, SCALE))
    pt1 = rs.VectorAdd(refPt, rs.VectorScale(span0, -SCALE))
    shape = rs.AddLine(pt0, pt1)
    
    return shape

def drawPlaneSpace(refPt, spanVecs):
    
    span0, span1 = spanVecs
    vec0 = rs.VectorAdd(rs.VectorScale(span0, -SCALE), rs.VectorScale(span1, -SCALE))
    vec1 = rs.VectorAdd(rs.VectorScale(span0, -SCALE), rs.VectorScale(span1, SCALE))
    vec2 = rs.VectorAdd(rs.VectorScale(span0, SCALE), rs.VectorScale(span1, SCALE))
    vec3 = rs.VectorAdd(rs.VectorScale(span0, SCALE), rs.VectorScale(span1, -SCALE))
    pt0 = rs.PointAdd(refPt, vec0)
    pt1 = rs.PointAdd(refPt, vec1)
    pt2 = rs.PointAdd(refPt, vec2)
    pt3 = rs.PointAdd(refPt, vec3)
    shape = rs.AddSrfPt([pt0, pt1, pt2, pt3])
    
    return shape

def drawBoxSpace(refPt, spanVecs):
    
    span0, span1, span2 = spanVecs
    vec0 = rs.VectorAdd(rs.VectorScale(span0, -SCALE), rs.VectorScale(span1, -SCALE))
    vec1 = rs.VectorAdd(rs.VectorScale(span0, -SCALE), rs.VectorScale(span1, SCALE))
    vec2 = rs.VectorAdd(rs.VectorScale(span0, SCALE), rs.VectorScale(span1, SCALE))
    vec3 = rs.VectorAdd(rs.VectorScale(span0, SCALE), rs.VectorScale(span1, -SCALE))
    pt0 = rs.PointAdd(refPt, vec0)
    pt1 = rs.PointAdd(refPt, vec1)
    pt2 = rs.PointAdd(refPt, vec2)
    pt3 = rs.PointAdd(refPt, vec3)
    
    pts = []
    for i in [-1, 1]:
        pts += rs.CopyObjects([pt0, pt1, pt2, pt3], rs.VectorScale(span2, i * SCALE))
    shape = rs.AddBox(pts)
    
    return shape

def drawLine(refPt, vec):
    
    vecScaled = rs.VectorScale(rs.VectorUnitize(vec), SCALE)
    refPt0 = rs.VectorSubtract(refPt, vecScaled)
    refPt1 = rs.VectorAdd(refPt, vecScaled)
    line = rs.AddLine(refPt0, refPt1)
    
    return line

def unpackSpans(vecs):
    
    spanVecs = []
    
    if(len(vecs) == 0): return spanVecs
    for vec in vecs:
        if(len(vec) == 0): continue
        newVec = rs.AddPoint(vec)
        spanVecs += [newVec]
    
    return spanVecs

def view(motion):
    moType, axis, refPt, spanVecs = motion
    
    # convert
    axis = [rs.AddPoint(vec) for vec in axis]
    refPt = rs.AddPoint(refPt)
    if(shift):
        refPt = rs.PointAdd(refPt, shift)
    spanVecs = unpackSpans(spanVecs)
    
    isTrans = moType == 't'
    color = colorCode[moType] if isFreedom else colorCode['c']
    viewObjs = []
    
    # axis view
    axisToDisp = spanVecs if isTrans else axis
    for vec in axisToDisp:
        # draw line
        vc.addLine(drawLine(refPt, vec))
        # draw axis element
        if(isTrans): # translation arrow
            for dir in [1, -1]:
                v = rs.VectorScale(rs.AddPoint(vec), dir * SCALE)
                arrow = drawArrow(refPt, v)
                vc.addAxes((arrow, color))
        if(not isTrans): # rotation axis
            line = rs.AddLine(rs.PointAdd(refPt, rs.VectorScale(vec,  SCALE)),
                              rs.PointAdd(refPt, rs.VectorScale(vec, -SCALE)))
            shapes = drawRotAxis(line)
            for shape in shapes: vc.addAxes((shape, color))
    
    # span view
    spanDeg = len(spanVecs)
    if(spanDeg == 0): # point
        pt = viewPt if isTrans else refPt
        shape = drawPointSpace(pt, spanVecs)
    elif(spanDeg == 1):
        shape = drawLineSpace(refPt, spanVecs)
    elif(spanDeg == 2):
        shape = drawPlaneSpace(refPt, spanVecs)
    elif(spanDeg == 3):
        shape = drawBoxSpace(refPt, spanVecs)
    else:
        assert False
    vc.addSpaces((shape, color))

def twoSidedArrow(line):
    
    midPt = rs.CurveMidPoint(line)
    vec = rs.PointSubtract(rs.CurveEndPoint(line), midPt)
    vecNeg = rs.VectorReverse(vec)
    
    return [drawArrow(midPt, vec)] + [drawArrow(midPt, vecNeg)]

axes = []
shapes = []

for line in arrows:
    axes += twoSidedArrow(line)
axes += blades
for pt in points:
    shapes += [rs.AddSphere(pt, 2)]
for line in lines:
    shapes += rs.AddPipe(line, 0, .25)
shapes += planes + boxes
# ---------- end python ----------
series_3 = Series(Start=pt, Step=1, Count=10)
Y = UnitY(Factor=series_2)
move = Move(Geometry=pt, Motion=X)  # -> graft(Geometry), Transform
midpt = CurveMiddle(Curve=arrows)
area = Area(Geometry=python.shapes)  # -> Area, Centroid
move_2 = Move(Geometry=move.Geometry, Motion=Y)  # -> simplify(graft(Geometry)), Transform
pdecon = Deconstruct(Point=midpt)  # -> XComponent, YComponent, ZComponent
pdecon_2 = Deconstruct(Point=area.Centroid)  # -> XComponent, YComponent, ZComponent
pt_2 = ConstructPoint(XCoordinate=pdecon.XComponent, YCoordinate=pdecon.YComponent, ZCoordinate=0)
pt_3 = ConstructPoint(XCoordinate=pdecon_2.XComponent, YCoordinate=pdecon_2.YComponent, ZCoordinate=0)
rectangle = Rectangle(Plane=move_2.Geometry, XSize=number_slider, YSize=neg, Radius=0)  # -> Rectangle, Length
path_mapper = PathMapper(rectangle.Rectangle, source="{A;B}", target="{A+1;B}")
incurve = PointInCurve(Point=pt_2, Curve=path_mapper)  # -> Relationship, Point
incurve_2 = PointInCurve(Point=pt_3, Curve=path_mapper)  # -> Relationship, Point
pcen = PolygonCenter(Polyline=path_mapper)  # -> CenterV, CenterE, CenterA
dispatch = Dispatch(List=arrows, DispatchPattern=incurve.Relationship)  # -> ListA, ListB
Y_2 = UnitY(Factor=1)
X_2 = UnitX(Factor=-1)
dispatch_2 = Dispatch(List=python.shapes, DispatchPattern=incurve_2.Relationship)  # -> ListA, ListB
pl = ConstructPlane(Origin=pcen.CenterV, XAxis=Y_2, YAxis=X_2)
spaces = ClusterOutput(dispatch_2.ListA)
frame = ClusterOutput(pl)
axes = ClusterOutput(dispatch.ListA)
